% Simulink data dictionary MtrCtrl_v01.sldd

K_slide = Simulink.Parameter(1, DataType="double")
KCCM_VoltMode_Flg = Simulink.Parameter(0, DataType="boolean")
Ureal = Simulink.Parameter(560)
KCCM_VoltModeEna_Flg = Simulink.Parameter(0, DataType="boolean")
KCCM_VirPosn_flg = Simulink.Parameter(0, DataType="boolean")
KSMO_EnaEst_Flg = Simulink.Parameter(0, DataType="boolean")
C_LUT_AngleTable_sng_Null = Simulink.Parameter([0.001533981 0.003067962 0.004601942 0.006135923 0.007669904 0.009203885 0.01073787 0.01227185 0.01380583 0.01533981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 1.570796], DataType="single")
C_LUT_SinTable_sng_Null = Simulink.Parameter([0.00153398 0.003067957 0.004601926 0.006135885 0.007669829 0.009203755 0.01073766 0.01227154 0.01380539 0.01533921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 1], DataType="single")
F = Simulink.Parameter(500)
PU = Simulink.Parameter(0.6844444)
P_pu = Simulink.Parameter(0.6844444)
Pn = Simulink.Parameter(35000)
Preal = Simulink.Parameter(213388.7)
RBase_Ohm = Simulink.Parameter(2)
Rs = Simulink.Parameter(0.05)
Rs_pu = Simulink.Parameter(0.025)
SBase_W = Simulink.Parameter(311769.1)
TqBase_Nm = Simulink.Parameter(992.392)
Ts_pu = Simulink.Parameter(0.1256637)
UBase_V = Simulink.Parameter(600)
U_pu = Simulink.Parameter(0.9333333)
Udc = Simulink.Parameter(560)
ZBase_Ohm = Simulink.Parameter(2)
n = Simulink.Parameter(3000)
nBase_RPM = Simulink.Parameter(3000)
tBase_s = Simulink.Parameter(0.0007957747)
wBase_rps = Simulink.Parameter(1256.637)
wmBase_rps = Simulink.Parameter(314.1593)
Id = Simulink.Parameter(1)
Iq = Simulink.Parameter(1)
Ld = Simulink.Parameter(0.000635)
Ud = Simulink.Parameter(0.05)
Uq = Simulink.Parameter(0.24327)
dt = Simulink.Parameter(1)
we = Simulink.Parameter(1)
B = Simulink.Parameter(0.001889)
Lq = Simulink.Parameter(0.000685)
SMOGain_V = Simulink.Parameter(323.3162)
LPF_coefg = Simulink.Parameter(0.01)
SecPerRnd = Simulink.Parameter(0.6)
IBase_A = Simulink.Parameter(2000)
OneOverUBase_V = Simulink.Parameter(0.001666667, DataType="fixdt(1,32,31)")
C_MATH_SqrtThreeOverThree_s32n31_Null = Simulink.Parameter(0.5773503, DataType="fixdt(1,32,31)")
C_MATH_Pi_u32n30_Null = Simulink.Parameter(3.141593, DataType="fixdt(0,32,30)")
K_SVM_DefultDuty_s32n31_Null = Simulink.Parameter(0.25, DataType="fixdt(1,32,31)")
C_PMSM_Flux_u32n32_Vs = Simulink.Parameter(0.192, DataType="fixdt(0,32,32)")
C_MATH_OneOverSqrtThree_s32n31_Null = Simulink.Parameter(0.5773503, DataType="fixdt(1,32,31)")
C_PMSM_CurQKp_u32n31_null = Simulink.Parameter(19.94911, DataType="fixdt(0,32,27)")
C_PMSM_Ls_pu = Simulink.Parameter(0.3989823, DataType="fixdt(0,32,32)")
C_PMSM_PolePairs_u8_Null = Simulink.Parameter(4, DataType="uint8")
FBase_Hz = 200
F_pu = 2.5
Flux = 0.192
FluxBase_Vs = 0.4774648
Flux_pu = 0.4021239
I_pu = 0.7333333
Ireal = 220
J = 0.011
JBase_kgmm = 3.158882
Ki = 0.01570796
Ki_pu = 0.04934802
Kis = 114583.3
Kp = 1.994911
Kp_pu = 6.267199
Kps = 57.29167
Kt = 1.152
LBase_H = 0.001591549
Ls = 0.000635
Ls_pu = 0.3989823
PBase_W = 311769.1
Pp = 4
C_PMSM_CurQKi_u32n31_null = Simulink.Parameter(0.1570796, DataType="fixdt(0,32,31)")
Ts = Simulink.Parameter(1.0e-6)
K_CCM_MRASEna_bool_Flg = Simulink.Parameter(0, DataType="boolean")
Kf_p = Simulink.Parameter(1, DataType="single")
Kf_i = Simulink.Parameter(0, DataType="single")
Kr = Simulink.Parameter(0.002)
Kl = Simulink.Parameter(0.0001)
TsCtrl = 0.0001
Kr_i = Simulink.Parameter(0.0001)
Kl_i = Simulink.Parameter(1.0e-5)