% Simulink data dictionary MtrCtrl_v01.sldd

F = 500
FBase_Hz = 200
F_pu = 2.5
Flux = 0.192
FluxBase_Vs = 0.4774648
Flux_pu = 0.4021239
I_pu = 0.7333333
Ireal = 220
J = 0.011
JBase_kgmm = 3.158882
Ki_pu = 78.95684
Kis = 114583.3
Kp_pu = 6.267199
Kps = 57.29167
Kt = 1.152
LBase_H = 0.001591549
Ls = 0.000635
Ls_pu = 0.3989823
PBase_W = 311769.1
PU = 0.6844444
P_pu = 0.6844444
Pn = 35000
Pp = 4
Preal = 213388.7
RBase_Ohm = 2
Rs = 0.05
Rs_pu = 0.025
SBase_W = 311769.1
TqBase_Nm = 992.392
Ts = 0.0001
Ts_pu = 0.1256637
UBase_V = 600
U_pu = 0.9333333
Udc = 560
ZBase_Ohm = 2
n = 3000
nBase_RPM = 3000
tBase_s = 0.0007957747
wBase_rps = 1256.637
wmBase_rps = 314.1593
Id = 1
Iq = 1
Ld = 0.000635
Ud = 0.05
Uq = 0.24327
dt = 1
we = 1
B = 0.001889
K_slide = Simulink.Parameter(1, DataType="double")
Lq = 0.000685
SMOGain_V = 323.3162
LPF_coefg = 0.01
SecPerRnd = 0.6
KCCM_VoltMode_Flg = Simulink.Parameter(0, DataType="boolean")
Ureal = Simulink.Parameter(560)

sinTable = Simulink.Parameter([0.00153398 0.003067957 0.004601926 0.006135885 0.007669829 0.009203755 0.01073766 0.01227154 0.01380539 0.01533921 0.01687299 0.01840673 0.01994043 0.02147408 0.02300768 0.02454123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
 0.001533981 0.003067962 0.004601942 0.006135923 0.007669904 0.009203885 0.01073787 0.01227185 0.01380583 0.01533981 0.01687379 0.01840777 0.01994175 0.02147573 0.02300971 0.02454369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 ], DataType="fixdt(0,32,31)")

cosTable = Simulink.Parameter([0.9999988 0.9999953 0.9999894 0.9999812 0.9999706 0.9999576 0.9999423 0.9999247 0.9999047 0.9998823 0.9998576 0.9998306 0.9998012 0.9997694 0.9997353 0.9996988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
 0.001533981 0.003067962 0.004601942 0.006135923 0.007669904 0.009203885 0.01073787 0.01227185 0.01380583 0.01533981 0.01687379 0.01840777 0.01994175 0.02147573 0.02300971 0.02454369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 ], DataType="fixdt(0,32,31)")

KCCM_VoltModeEna_Flg = Simulink.Parameter(0, DataType="boolean")
IBase_A = 2000
KCCM_VirPosn_flg = Simulink.Parameter(0, DataType="boolean")
KSMO_EnaEst_Flg = Simulink.Parameter(0, DataType="boolean")
Ki = 0.01570796
Kp = 1.994911
ASd = Simulink.Parameter([])